# Grasshopper definition 221015_Arc.gh (Grasshopper 1.0.7)
# plug-ins: BubalusGH2.0, Human, Hops

input = DataInput(
    Destination="/Volumes/GoogleDrive-110500231569640047002/Общие диски/CONTEXTMACHINE/PROJECTS/2202_Lahta_Arc/Lahta Arc_WORK/MM/gh_data/Arc_panels_test.ghdata",
    RelativePath="/Volumes/GoogleDrive-110500231569640047002/Общие диски/CONTEXTMACHINE/PROJECTS/2202_Lahta_Arc/Lahta Arc_WORK/MM/gh_data/Arc_panels_test.ghdata|../../../../../../Volumes/GoogleDrive-110500231569640047002/Общие диски/CONTEXTMACHINE/PROJECTS/2202_Lahta_Arc/Lahta Arc_WORK/MM/gh_data/Arc_panels_test.ghdata",
    UpdateDelay=50000)  # -> Left_Cone_panels_surf_6_row, Left_Cone_panels_surf_6x2_row, Right_Cone_panels_surf_6_row, Right_Cone_panels_surf_6x2_row, Left_Cone_recess_surf, Right_Cone_recess_surf, Hyp_panels_surf_6_row, Hyp_panels_surf_6x2_row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
srf = Surface(flatten(input.Hyp_recess_Vert_01))
srf_2 = Surface(flatten(input.Hyp_recess_Vert_02))
srf_3 = Surface(flatten(input.Hyp_panels_surf_6x2_row))
file = ReadFile(File="/Users/sofyadobycina/Documents/GitHub/mmodel/panels_gh/main_arc.py", PerLineParse=False)
file_2 = ReadFile(File="/Users/sofyadobycina/Documents/GitHub/mmodel/panels_gh/main_niche.py", PerLineParse=False)
extendcrvonsrf = ExtendCrvOnSrf(Curve=<missing>, Surface=graft(<missing>))

# ---- group: OTGIB
number_slider = Slider(35.2, range=0..100)
panel = Panel("http://192.168.3.10:5000/POST")
toggle = BooleanToggle(True)
panel_2 = Panel("object/create")

# ----
python = GhPythonScript(
    angle_niche=Slider(45, range=0..100),
    side_niche=Slider(0.3, range=0..1),
    met_left_niche=Slider(0.5, range=0..1),
    init_side=number_slider)  # -> out, a
# ---------- python: Python ----------
__author__ = "sofyadobycina"

import rhinoscriptsyntax as rs
import math

def angle_ofs(angle, side, met_left):
    ang = math.radians(90/2)
    rad = ((side / 2) / math.cos(ang)) + met_left
    return rad / math.tan(math.radians(angle/2))


def right_angle_ofs(side, met_left):
    ang = math.radians(90 / 2)
    rad = ((side / 2) / math.cos(ang)) + met_left
    return rad

def niche_offset(angle, side, met_left):
    d = angle_ofs(angle, side, met_left) - right_angle_ofs(side, met_left)
    return d * math.tan(math.radians(angle))

def niche_shorten(angle, side, met_left):
    d = angle_ofs(angle, side, met_left) - right_angle_ofs(side, met_left)
    return d / math.cos(math.radians(angle))


side_offset = niche_offset(angle_niche, side_niche, met_left_niche) + (angle_ofs(angle_niche, side_niche, met_left_niche)-right_angle_ofs(side_niche, met_left_niche)) - 0.5
a = init_side - side_offset
print(a)
# ---------- end python ----------

# ---- group: OTGIB
python_2 = GhPythonScript(
    dtype="BendSegmentFres",
    angle=Slider(90, range=1..179),
    radius=Slider(0.712, range=0..10),
    length=Slider(35.2, range=0..100),
    in_rad=Slider(0.2, range=0..1),
    metal_width=Slider(3, range=0..10))  # -> out, a
# ---------- python_2: Python ----------
__author__ = "andrewastakhov"

import rhinoscriptsyntax as rs
import json
from ghpythonlib.treehelpers import list_to_tree, tree_to_list
import Grasshopper
access=Grasshopper.Kernel.GH_ParamAccess
class ApiClass:
    def __init__(self, **kwargs):
        self.__dict__.update(self.__class__.__component_dict__)
        self.__dict__.update(kwargs)
      
    def to_dict(self):
        return self.__dict__
    def __str__(self):
        return "{}(\n\t{}\n)".format(self.dtype, json.dumps(self.__dict__, indent=3)[1:-1])
    def ToString(self):
        return self.__str__()

class ApiType(type):
    def __new__(mcs, name, bases=(), attrs={}):
        attrs['__component_dict__']=dict()

        for prm in ghenv.Component.Params.Input:
            print(prm.Name)
            d=globals()[prm.Name]
            if prm.Access == access.item:
                attrs['__component_dict__'][prm.Name]=d
            elif prm.Access == access(Grasshopper.Kernel.GH_ParamAccess.list):
                attrs['__component_dict__'][prm.Name]=list(d)
            else:
                attrs['__component_dict__'][prm.Name]=tree_to_list(d)

        attrs.update(ApiClass.__dict__)
        attrs['dtype'] = name
        return type(name, bases, attrs)



objs= ApiType(dtype)()



a=objs
# ---------- end python_2 ----------
toggle_2 = BooleanToggle(True)
panel_3 = Panel("object/create")
bendschema = GhPythonScript(x=python_2.a)  # -> a; inputs x: list
# ---------- bendschema: Python ----------
__author__ = "andrewastakhov"

import rhinoscriptsyntax as rs
import json


class Bend(list):
    def __init__(self, seq):
        super(Bend, self).__init__(seq)
        self.seq=seq
    def to_json(self):
        l=[]
        for s in self.seq:
            l.append(s.to_dict())
        return json.dumps({"segments":l}, indent=3)
    def to_simple(self):
        l=[]
        for s in self.seq:
            l.append([s.angle,s.radius, s.length])
        return json.dumps({"segments":l}, indent=3)

a = Bend(x).to_json()
b = Bend(x).to_simple()
# ---------- end bendschema ----------

# ----
hops = Hops(
    _Path="http://192.168.3.10:5000/POST",
    Run=toggle_2,
    Name=panel_3,
    Data=bendschema,
    CacheResultsInMemory=False,
    CacheSolveResults=False,
    RemoteDefinitionLocation="http://192.168.3.10:5000/POST",
    RemoteSolveVersion=(0, 1, 0),
    ShowInput_Enabled=False,
    ShowInput_Path=True,
    SynchronousSolve=True)

# ---- group: OTGIB (continued)
python_3 = GhPythonScript(mmodel_object=hops)  # -> out, inner, outer
# ---------- python_3: Python ----------
__author__ = "andrewastakhov"

import rhinoscriptsyntax as rs
import json
from ghpythonlib.treehelpers import list_to_tree, tree_to_list
from compas.geometry import Line, Point, NurbsCurve, Curve, Polyline
from compas_rhino.geometry import RhinoNurbsCurve
from compas_ghpython.artists import CurveArtist

import Grasshopper
access=Grasshopper.Kernel.GH_ParamAccess
class ApiClass:
    def __init__(self, **kwargs):
        self.__dict__.update(self.__class__.__component_dict__)
        self.__dict__.update(kwargs)
      
    def to_dict(self):
        return self.__dict__
    def __str__(self):
        return "{}(\n\t{}\n)".format(self.dtype, json.dumps(self.__dict__, indent=3)[1:-1])
    def ToString(self):
        return self.__str__()

class ApiType(type):
    def __new__(mcs, name, bases=(), attrs={}):
        attrs['__component_dict__']=dict()

        for prm in ghenv.Component.Params.Input:
            d=globals()[prm.Name]
            if prm.Access == access.item:
                attrs['__component_dict__'][prm.Name]=d
            elif prm.Access == access(Grasshopper.Kernel.GH_ParamAccess.list):
                attrs['__component_dict__'][prm.Name]=list(d)
            else:
                attrs['__component_dict__'][prm.Name]=tree_to_list(d)

        attrs.update(ApiClass.__dict__)
        attrs['dtype'] = name
        return type(name, bases, attrs)

import json
import Rhino.Geometry as rg
data=json.loads(mmodel_object)
metadata=ApiType("metadata")(**data["metadata"])
class Obj(rg.GeometryBase):
    def __init__(self):
        super(rg.GeometryBase).__init__(self)
print rg.GeometryBase.ConstructConstObject.__doc__
obj=[]
for i, d in enumerate(data["data"]["rhino"]):
    obj.append(rg.GeometryBase.FromJSON(json.dumps(d)))
    
inner = []
outer = []
for i, d in enumerate(data["data"]["compas"]):
    v = RhinoNurbsCurve.from_data(d)
    b = CurveArtist(v)
    if i < len(data["data"]["compas"])/2:
        inner.append(b.draw())
    else:
        outer.append(b.draw())

print(inner)
# ---------- end python_3 ----------
crv = Curve(python_3.inner)
crv_2 = Curve(python_3.outer)
join = JoinCurves(Curves=crv_2, Preserve=False)
join_2 = JoinCurves(Curves=crv, Preserve=False)
end = EndPoints(Curve=join_2)  # -> Start, End
end_2 = EndPoints(Curve=join)  # -> Start, End
vec2pt = Vector2Pt(PointA=end_2.Start, PointB=end.Start, Unitize=False)  # -> Vector, Length
move = Move(Geometry=join, Motion=vec2pt.Vector)  # -> Geometry, Transform
move_2 = Move(Geometry=join_2, Motion=vec2pt.Vector)  # -> Geometry, Transform
end_3 = EndPoints(Curve=move.Geometry)  # -> Start, End
end_4 = EndPoints(Curve=move_2.Geometry)  # -> Start, End
ln = Line(StartPoint=end_4.Start, EndPoint=end_3.Start)
ln_2 = Line(StartPoint=end_4.End, EndPoint=end_3.End)
merge = Merge(Data1=move_2.Geometry, Data2=ln, Data3=move.Geometry, Data4=ln_2)
boundary = BoundarySurfaces(Edges=merge)

python_4 = GhPythonScript(
    dtype="BendSegmentFres",
    angle=Slider(45, range=1..179),
    radius=Slider(0.712, range=0..10),
    length=Slider(35.2, range=0..100),
    in_rad=Slider(0.2, range=0..1),
    metal_width=Slider(3, range=0..10))  # -> out, a; same code as python_2
panel_4 = Panel("http://192.168.3.10:5000/POST")
toggle_3 = BooleanToggle(True)
panel_5 = Panel("object/create")
bendschema_2 = GhPythonScript(x=python_4.a)  # -> a; inputs x: list; same code as bendschema

# ----
hops_2 = Hops(
    _Path=panel_4,
    Run=toggle_3,
    Name=panel_5,
    Data=bendschema_2,
    CacheResultsInMemory=False,
    CacheSolveResults=False,
    RemoteDefinitionLocation="http://192.168.3.10:5000/POST",
    RemoteSolveVersion=(0, 1, 0),
    ShowInput_Enabled=False,
    ShowInput_Path=True,
    SynchronousSolve=True)

# ---- group: OTGIB (continued)
python_5 = GhPythonScript(mmodel_object=hops_2)  # -> out, inner, outer; same code as python_3
crv_3 = Curve(python_5.inner)
crv_4 = Curve(python_5.outer)
join_3 = JoinCurves(Curves=crv_4, Preserve=False)
join_4 = JoinCurves(Curves=crv_3, Preserve=False)
end_5 = EndPoints(Curve=join_4)  # -> Start, End
end_6 = EndPoints(Curve=join_3)  # -> Start, End
vec2pt_2 = Vector2Pt(PointA=end_6.Start, PointB=end_5.Start, Unitize=False)  # -> Vector, Length
move_3 = Move(Geometry=join_3, Motion=vec2pt_2.Vector)  # -> Geometry, Transform
move_4 = Move(Geometry=join_4, Motion=vec2pt_2.Vector)  # -> Geometry, Transform
end_7 = EndPoints(Curve=move_3.Geometry)  # -> Start, End
end_8 = EndPoints(Curve=move_4.Geometry)  # -> Start, End
ln_3 = Line(StartPoint=end_8.Start, EndPoint=end_7.Start)
ln_4 = Line(StartPoint=end_8.End, EndPoint=end_7.End)
merge_2 = Merge(Data1=move_4.Geometry, Data2=ln_3, Data3=move_3.Geometry, Data4=ln_4)
boundary_2 = BoundarySurfaces(Edges=merge_2)

# ----
python_6 = GhPythonScript(Code=file, Panels=flatten(input.Hyp_panels_surf_6x2_row), Otgib_side=boundary, Otgib_niche=boundary_2)  # -> Out, A, O_left, S_left, O_right, S_right
brep = Brep(python_6.O_left)
brep_2 = Brep(python_6.O_right)
srf_4 = Surface(python_6.S_right)
srf_5 = Surface(python_6.S_left)
pln = Plane(python_6.A)
item = ListItem(List=pln, Index=Slider(3, range=0..10), Wrap=True)
previewmat = CustomPreviewMaterials(Geometry=brep, DiffuseColor=ColourSwatch(SwatchColor=RGB(130, 0, 237)))
previewmat_2 = CustomPreviewMaterials(Geometry=brep_2, DiffuseColor=ColourSwatch(SwatchColor=RGB(0, 93, 255)))
panel_6 = Panel(brep_2)
deplane = DeconstructPlane(Plane=item)  # -> Origin, XAxis, YAxis, ZAxis
previewmat_3 = CustomPreviewMaterials(Geometry=srf_4, DiffuseColor=ColourSwatch(SwatchColor=RGB(176, 176, 176)))
previewmat_4 = CustomPreviewMaterials(Geometry=srf_5, DiffuseColor=ColourSwatch(SwatchColor=RGB(176, 176, 176)))

# ---- group: OTGIB (continued)
python_7 = GhPythonScript(
    dtype="BendSegmentFres",
    angle=Slider(45, range=1..179),
    radius=Slider(0.712, range=0..10),
    length=python.a,
    in_rad=Slider(0.2, range=0..1),
    metal_width=Slider(3, range=0..10))  # -> out, a; same code as python_2
bendschema_3 = GhPythonScript(x=python_7.a)  # -> a; inputs x: list; same code as bendschema

# ----
hops_3 = Hops(
    _Path=panel,
    Run=toggle,
    Name=panel_2,
    Data=bendschema_3,
    CacheResultsInMemory=False,
    CacheSolveResults=False,
    RemoteDefinitionLocation="http://192.168.3.10:5000/POST",
    RemoteSolveVersion=(0, 1, 0),
    ShowInput_Enabled=False,
    ShowInput_Path=True,
    SynchronousSolve=True)

# ---- group: OTGIB (continued)
python_8 = GhPythonScript(mmodel_object=hops_3)  # -> out, inner, outer; same code as python_3
crv_5 = Curve(python_8.inner)
crv_6 = Curve(python_8.outer)
join_5 = JoinCurves(Curves=crv_6, Preserve=False)
join_6 = JoinCurves(Curves=crv_5, Preserve=False)
end_9 = EndPoints(Curve=join_6)  # -> Start, End
end_10 = EndPoints(Curve=join_5)  # -> Start, End
vec2pt_3 = Vector2Pt(PointA=end_10.Start, PointB=end_9.Start, Unitize=False)  # -> Vector, Length
move_5 = Move(Geometry=join_5, Motion=vec2pt_3.Vector)  # -> Geometry, Transform
move_6 = Move(Geometry=join_6, Motion=vec2pt_3.Vector)  # -> Geometry, Transform
end_11 = EndPoints(Curve=move_5.Geometry)  # -> Start, End
end_12 = EndPoints(Curve=move_6.Geometry)  # -> Start, End
ln_5 = Line(StartPoint=end_12.Start, EndPoint=end_11.Start)
ln_6 = Line(StartPoint=end_12.End, EndPoint=end_11.End)
merge_3 = Merge(Data1=move_6.Geometry, Data2=ln_5, Data3=move_5.Geometry, Data4=ln_6)
boundary_3 = BoundarySurfaces(Edges=merge_3)

# ----
python_9 = GhPythonScript(Code=file_2, Niche_left=srf, Niche_right=srf_2, Otgib_niche=boundary_3)  # -> Out, A, N_left, S_left, N_right, S_right, B
crv_7 = Curve(python_9.A)
pln_2 = Plane(python_9.B)
pln_3 = Plane(python_9.N_left)
brep_3 = Brep(python_9.N_left)
srf_6 = Surface(python_9.S_left)
srf_7 = Surface(python_9.S_right)
brep_4 = Brep(python_9.N_right)
item_2 = ListItem(List=pln_2, Index=Slider(3, range=0..10), Wrap=True)
pln_4 = Plane(python_9.N_right)
deplane_2 = DeconstructPlane(Plane=item_2)  # -> Origin, XAxis, YAxis, ZAxis
previewmat_5 = CustomPreviewMaterials(Geometry=brep_4, DiffuseColor=ColourSwatch(SwatchColor=RGB(0, 207, 48)))
previewmat_6 = CustomPreviewMaterials(Geometry=brep_3, DiffuseColor=ColourSwatch(SwatchColor=RGB(255, 238, 0)))
item_3 = ListItem(List=pln_4, Index=0, Wrap=True)
angle = Angle(VectorA=deplane_2.XAxis, VectorB=deplane.XAxis)  # -> Angle, Reflex
end_13 = EndPoints(Curve=crv_7)  # -> Start, End
deg = Degrees(Radians=angle.Angle)
pt = Point(end_13.End)
panel_7 = Panel(deg)
previewmat_7 = CustomPreviewMaterials(Geometry=srf_6, DiffuseColor=ColourSwatch(SwatchColor=RGB(128, 128, 128)), Transparency=Slider(0, range=0..1))
previewmat_8 = CustomPreviewMaterials(Geometry=srf_7, DiffuseColor=ColourSwatch(SwatchColor=RGB(128, 128, 128)), Transparency=Slider(0, range=0..1))
item_4 = ListItem(List=pt, Index=Slider(3, range=0..10), Wrap=True)
panel_8 = Panel(end_13.End)
